# Grasshopper definition HoloFab_Testing.gh (Grasshopper 1.0.7)
# plug-ins: treesloth01, HoloFab

panel = Panel("192.168.1.112")
C = CreateConnection(Address="199.5.80.149", Send=Toggle(False))
number_slider = Slider(426, range=0..1000)  # disabled
number_slider_2 = Slider(200, range=0..1000)  # disabled
xy = XYPlane(Origin=Point(0, 0, 0))  # disabled
xz = XZPlane(Origin=Point(0, 0, 0))  # disabled
ui = UIReceiver(Connect=C)  # -> Toggles, Counters, Sliders; disabled
number_slider_3 = Slider(103, range=0..1000)  # disabled
number_slider_4 = Slider(78, range=0..100)  # disabled
number_slider_5 = Slider(100, range=0..100)  # disabled
number_slider_6 = Slider(3, range=3..10)  # disabled
robot = ValueList({"Choose Robot", "KR150-2_110", "IRB140", "IRB120"}, selected="IRB120")
robot_2 = ValueList({"Choose Robot", "KR150-2_110", "IRB140", "IRB120"}, selected="IRB140")
rectangle = Rectangle(Plane=xy, XSize=number_slider, YSize=number_slider, Radius=0)  # -> Rectangle, Length; disabled
rectangle_2 = Rectangle(Plane=PlaneXY(0, 0, 0), XSize=number_slider_2, YSize=number_slider_2, Radius=0)  # -> Rectangle, Length; disabled
pt = ConstructPoint(XCoordinate=0, YCoordinate=0, ZCoordinate=number_slider_2)  # disabled
genes = GenePool(Decimals=3, Maximum=3.141, Minimum=0, Value=[0.404, 0.212, 0.768, 0.154, 0, 0])
genes_2 = GenePool(Decimals=3, Maximum=3.141, Minimum=0, Value=[3.141, 1.081, 0.554, 0.305, 1.411, 2.407])
panel_2 = Panel(ui.Counters)  # disabled
panel_3 = Panel(ui.Toggles)  # disabled
panel_4 = Panel(ui.Sliders)  # disabled
pt_2 = ConstructPoint(XCoordinate=Slider(21, range=-1000..1000), YCoordinate=Slider(0, range=0..1000), ZCoordinate=Slider(0, range=0..1000))
pt_3 = ConstructPoint(XCoordinate=Slider(0, range=0..1000), YCoordinate=Slider(523, range=0..1000), ZCoordinate=Slider(0, range=0..1000))
panel_5 = Panel("1")  # disabled
panel_6 = Panel("1")  # disabled
swatch = ColourSwatch(SwatchColor=RGB(66, 72, 252))
swatch_2 = ColourSwatch(SwatchColor=RGBA(255, 255, 255, 111))  # disabled
swatch_3 = ColourSwatch(SwatchColor=RGBA(242, 255, 0, 122))  # disabled
pt_4 = ConstructPoint(XCoordinate=0, YCoordinate=0, ZCoordinate=number_slider_3)  # disabled
mplane = MeshPlane(Boundary=rectangle_2.Rectangle, WidthCount=panel_5, HeightCount=panel_5)  # -> Mesh, Area; disabled
mplane_2 = MeshPlane(Boundary=rectangle.Rectangle, WidthCount=panel_6, HeightCount=panel_6)  # -> Mesh, Area; disabled
msphere = MeshSphere(Base=PlaneXY(0, 0, 0), Radius=number_slider_5, UCount=10, VCount=20)  # disabled
msphere_2 = MeshSphere(Base=pt, Radius=number_slider_4, UCount=number_slider_6, VCount=number_slider_6)  # disabled
panel_7 = Panel("2020")  # disabled
hb = HoloBot(Name=robot, ID=0, Plane=pt_2)
hb_2 = HoloBot(Name=robot_2, ID="1", Plane=pt_3)
stack = StackTrees(Data0=genes, Data1=genes_2, Reduce=True)
ms = MeshStreaming(Mesh=msphere, Color=swatch_2, Connect=C)  # disabled
ht = HoloTag(TextString=panel_7, TextLocation=pt_4, TextSize=20, TextColor=RGB(255, 255, 255), Connect=C)  # disabled
mesh_streaming_plus = MeshStreamingPlus(Mesh=mplane.Mesh, Color=swatch_3, Connect=C)  # disabled
rs = RobotStreaming(HoloBotS=[hb_2, hb], Connect=C)
rc = RobotController(HoloBot=[hb, hb_2], AxisValues=stack, Connect=C)  # disabled
